# Dynamo graph Estrapolare Geometria.dyn (Dynamo 2.1.0.7500)

# group: ESTRAI PUNTI INIZIALI E FINALI DA TRAVI ANALITICHE
# note: IPOTESI:
# -Tutti i telai sono orditi lungo Y e uguali tra di loro
# -Tutte le colonne hanno la medesima sezione
# -Tutte le travi di un singolo piano hanno la medesima sezione
# -Solo le travi sismoresistenti hanno modello analitico
# -Ad ogni Level corrisponde un piano dell'edificio
# -I telai hanno lo stesso passo di campata e di interpiano
categories = Categories("OST_BeamAnalytical")
all_elements_of_category = ElementsOfCategory(Category=categories)
geometry = Element.Geometry(element=all_elements_of_category)
# note: RESTITUISCE WARNING SE CI SONO TRAVI A GRAVITA', TUTTO NORMALE
byJoinedCurves = PolyCurve.ByJoinedCurves(curves=geometry)
clean = List.Clean(list=byJoinedCurves)
code_block = CodeBlock(x=clean) { x.EndPoint; x.StartPoint; }
join = List.Join(list0=code_block.out0, list1=code_block.out1)

# group: ELIMINO DOPPIONI E DIVIDO I NODI PER CIASCUN TELAIO
delete_duplicates = Python(IN[0]=join)
# ---------- delete_duplicates.python (13 lines) ----------
# Load the Python Standard and DesignScript Libraries
import sys
import clr
clr.AddReference('ProtoGeometry')
from Autodesk.DesignScript.Geometry import *

# The inputs to this node will be stored as a list in the IN variables.
input = IN[0]

# Place your code below this line

# Assign your output to the OUT variable.
OUT = set(input);
# ----------------------------------------
dividi_per_telaio = Python(IN[0]=delete_duplicates)
# ---------- dividi_per_telaio.python (28 lines) ----------
# Load the Python Standard and DesignScript Libraries
import sys
import clr
clr.AddReference('ProtoGeometry')
from Autodesk.DesignScript.Geometry import *

# The inputs to this node will be stored as a list in the IN variables.
input = IN[0]

# Place your code below this line
x_coordinates = []
points_by_frame = []

for element in input:
	x_coordinates.append(element.X)

x_coordinates = list(set(x_coordinates))
x_coordinates.sort()

for coordinate in x_coordinates:
	frame_points = []
	for element in input:
		if element.X == coordinate:
			frame_points.append(element)
	points_by_frame.append(frame_points)
			
# Assign your output to the OUT variable.
OUT = points_by_frame;
# ----------------------------------------
count = List.Count(list=dividi_per_telaio)

firstItem = List.FirstItem(list=dividi_per_telaio)
coordinates_y = Python(IN[0]=firstItem)
# ---------- coordinates_y.python (18 lines) ----------
# Load the Python Standard and DesignScript Libraries
import sys
import clr
clr.AddReference('ProtoGeometry')
from Autodesk.DesignScript.Geometry import *

# The inputs to this node will be stored as a list in the IN variables.
input = IN[0]

# Place your code below this line
y_coordinates = []

for element in input:
	y_coordinates.append(element.Y)

output = list(set(y_coordinates))
# Assign your output to the OUT variable.
OUT = output;
# ----------------------------------------

# group: CALCOLO LUNGHEZZA DELLA CAMPATA
sort = List.Sort(list=coordinates_y)
firstItem_2 = List.FirstItem(list=sort)
code_block_2 = CodeBlock { 1; }
getItemAtIndex = List.GetItemAtIndex(list=sort, index=code_block_2)
calcolo_campata = CodeBlock(x=firstItem_2, y=getItemAtIndex) { x - y; }

abs = Math.Abs(number=calcolo_campata)
mm_m = CodeBlock(x=abs) { x/1000; }

# group: OTTIENI QUOTE DEI PIANI
categories_2 = Categories("OST_Levels")
all_elements_of_category_2 = ElementsOfCategory(Category=categories_2)
elevations = Python(IN[0]=all_elements_of_category_2)
# ---------- elevations.python (15 lines) ----------
# Load the Python Standard and DesignScript Libraries
import sys
import clr
clr.AddReference('ProtoGeometry')
from Autodesk.DesignScript.Geometry import *

# The inputs to this node will be stored as a list in the IN variables.
input = IN[0]

# Place your code below this line
elevations = []
for element in input:
	elevations.append(round(element.Elevation))
# Assign your output to the OUT variable.
OUT = elevations;
# ----------------------------------------

# group: CALCOLO INTERPIANO
code_block_3 = CodeBlock { 1; }
getItemAtIndex_2 = List.GetItemAtIndex(list=elevations, index=code_block_3)

mm_m_2 = CodeBlock(x=getItemAtIndex_2) { x/1000; }

# group: A PARTIRE DAL NUMERO DI PIANI E I PUNTI DI UN SINGOLO TELAIO CALCOLO PIANI E CAMPATE
count_2 = List.Count(list=firstItem)
count_3 = List.Count(list=all_elements_of_category_2)
n1 = CodeBlock(x=count_3) { x-1; }  # "-1"
nodi_campate = CodeBlock(y=count_2, x=n1) { y/x-1; }

# group: ALTRI DATI TELAIO
massa_piano_tipo = CodeBlock { 140.8; }
massa_ultimo_piano = CodeBlock { 140.8; }
heff = CodeBlock { 4; }
n0 = CodeBlock { 0; }  # "0"

calcolo_array_masse = Python(IN[0]=n1, IN[1]=massa_piano_tipo, IN[2]=massa_ultimo_piano)
# ---------- calcolo_array_masse.python (19 lines) ----------
# Load the Python Standard and DesignScript Libraries
import sys
import clr
clr.AddReference('ProtoGeometry')
from Autodesk.DesignScript.Geometry import *

# The inputs to this node will be stored as a list in the IN variables.
m = IN[0]
storey_mass = IN[1]
roof_mass = IN[2]

# Place your code below this line
output = [0]
for j in range(1,m):
	output.append(storey_mass)
output.append(roof_mass)
	
# Assign your output to the OUT variable.
OUT = output
# ----------------------------------------
masse = Watch(calcolo_array_masse)
heff_2 = Watch(heff)

# group: ALTRI DATI SEZIONE
young_materiale_colonne_kpa = CodeBlock { 33346000; }
s_pilastro = CodeBlock { [122.9 ,109767 ,0 ,453]; }
s_piano_1 = CodeBlock { [57.8 ,63212 ,0 ,740.9]; }
s_piano_2 = CodeBlock { [57.8 ,63212 ,0 ,740.9]; }
n_pilastro = CodeBlock()
# ---------- n_pilastro.designscript (2 lines) ----------
[-0.0335582327524983 ,-0.00111961936124127 ,-0.0001 ,0 ,0.0001 ,0.00111961936124127 ,0.0335582327524983 ];
[-100.8 ,-96.7 ,-70.4 ,0 ,70.4 ,96.7 ,100.8 ];
# ----------------------------------------
pt_piano_1 = CodeBlock()
# ---------- pt_piano_1.designscript (2 lines) ----------
[-0.0237336465211697 ,-0.000914985291584369 ,-0.0001 ,0 ,0.0001 ,0.000914985291584369 ,0.0237336465211697 ];
[-127.1 ,-97.9 ,-36 ,0 ,36 ,97.9 ,127.1 ];
# ----------------------------------------
pt_piano_2 = CodeBlock()  # same code as pt_piano_1

young_materiale_travi_kpa = CodeBlock { 33346000; }
list_join_ma_fatto_bene = Python(IN[0]=young_materiale_colonne_kpa, IN[1]=young_materiale_travi_kpa)
# ---------- list_join_ma_fatto_bene.python (16 lines) ----------
# Load the Python Standard and DesignScript Libraries
import sys
import clr
clr.AddReference('ProtoGeometry')
from Autodesk.DesignScript.Geometry import *

# The inputs to this node will be stored as a list in the IN variables.
input = IN

# Place your code below this line
output = []
for element in input:
	output.append(element)
	
# Assign your output to the OUT variable.
OUT = output
# ----------------------------------------
MATERIALE = Watch(list_join_ma_fatto_bene)
list_join_ma_fatto_bene_2 = Python(IN[0]=s_pilastro, IN[1]=s_piano_1, IN[2]=s_piano_2)  # same code as list_join_ma_fatto_bene
S = Watch(list_join_ma_fatto_bene_2)
list_join_ma_fatto_bene_3 = Python(IN[0]=n_pilastro.out0, IN[1]=pt_piano_1.out0, IN[2]=pt_piano_2.out0)  # same code as list_join_ma_fatto_bene
STRAIN = Watch(list_join_ma_fatto_bene_3)
list_join_ma_fatto_bene_4 = Python(IN[0]=n_pilastro.out1, IN[1]=pt_piano_1.out1, IN[2]=pt_piano_2.out1)  # same code as list_join_ma_fatto_bene
STRESS = Watch(list_join_ma_fatto_bene_4)

# group: OTTENGO b & h COLONNE NELL'IPOTESI CHE SIANO TUTTE UGUALI
categories_3 = Categories("OST_StructuralColumns")
all_elements_of_category_3 = ElementsOfCategory(Category=categories_3)
firstItem_3 = List.FirstItem(list=all_elements_of_category_3)
code_block_4 = CodeBlock { "Family"; }
getParameterValueByName = Element.GetParameterValueByName(element=firstItem_3, parameterName=code_block_4)
parameters = Element.Parameters(element=getParameterValueByName)
get_b_and_h = Python(IN[0]=parameters)
# ---------- get_b_and_h.python (15 lines) ----------
# Load the Python Standard and DesignScript Libraries
import sys
import clr
clr.AddReference('ProtoGeometry')
from Autodesk.DesignScript.Geometry import *

# The inputs to this node will be stored as a list in the IN variables.
input = IN[0]

# Place your code below this line
output = []
output.append(input[2])
output.append(input[10])
# Assign your output to the OUT variable.
OUT = output;
# ----------------------------------------

# group: OTTENGO b & h DELLE TRAVI PIANO PER PIANO
categories_4 = Categories("OST_StructuralFraming")
all_elements_of_category_4 = ElementsOfCategory(Category=categories_4)
code_block_5 = CodeBlock { "Family"; }
code_block_6 = CodeBlock { "Elevation at Top"; }
restOfItems = List.RestOfItems(list=elevations)

code_block_7 = CodeBlock { "Enable Analytical Model"; }
getParameterValueByName_2 = Element.GetParameterValueByName(element=all_elements_of_category_4, parameterName=code_block_7)
int_bool = CodeBlock(x=getParameterValueByName_2) { x == 1; }
filterByBoolMask = List.FilterByBoolMask(list=all_elements_of_category_4, mask=int_bool)

# group (continued): OTTENGO b & h DELLE TRAVI PIANO PER PIANO
getParameterValueByName_3 = Element.GetParameterValueByName(element=filterByBoolMask.in, parameterName=code_block_5)
parameters_2 = Element.Parameters(element=getParameterValueByName_3)
get_b_and_h_2 = Python(IN[0]=parameters_2)
# ---------- get_b_and_h_2.python (19 lines) ----------
# Load the Python Standard and DesignScript Libraries
import sys
import clr
clr.AddReference('ProtoGeometry')
from Autodesk.DesignScript.Geometry import *

# The inputs to this node will be stored as a list in the IN variables.
input = IN[0]

# Place your code below this line
sections = []
for element in input:
	section = []
	section.append(element[2])
	section.append(element[11])
	sections.append(section)

# Assign your output to the OUT variable.
OUT = sections;
# ----------------------------------------
getParameterValueByName_4 = Element.GetParameterValueByName(element=filterByBoolMask.in, parameterName=code_block_6)
round = Math.Round(number=getParameterValueByName_4)
create_filter = Python(IN[0]=round, IN[1]=restOfItems)
# ---------- create_filter.python (26 lines) ----------
# Load the Python Standard and DesignScript Libraries
import sys
import clr
clr.AddReference('ProtoGeometry')
from Autodesk.DesignScript.Geometry import *

# The inputs to this node will be stored as a list in the IN variables.
beams = IN[0]
elevations = IN[1]

# Place your code below this line
def condition(elevation, beam):
	return elevation == beam
	
number_of_beams = []
for elevation in elevations:
	number_of_beams.append(sum(condition(elevation, beam) for beam in beams))
	
filter = []	
for number in number_of_beams:
	filter.append(True)
	for i in range(1,4):
		filter.append(False)
	
# Assign your output to the OUT variable.
OUT = filter
# ----------------------------------------
filterByBoolMask_2 = List.FilterByBoolMask(list=get_b_and_h_2, mask=create_filter)

# group: FORMATTO I DATI DELLE SEZIONI
string_from_object = FromObject(obj=get_b_and_h)
code_block_8 = CodeBlock { 0; 4; }
remove = String.Remove(str=string_from_object, startIndex=code_block_8.out0, count=code_block_8.out1)
toNumber = String.ToNumber(str=remove)
mm_m_3 = CodeBlock(x=toNumber) { x/1000; }
string_from_object_2 = FromObject(obj=filterByBoolMask_2.in)
remove_2 = String.Remove(str=string_from_object_2, startIndex=code_block_8.out0, count=code_block_8.out1)
toNumber_2 = String.ToNumber(str=remove_2)
mm_m_4 = CodeBlock(x=toNumber_2) { x/1000; }

addItemToFront = List.AddItemToFront(item=mm_m_3, list=mm_m_4)

# group: CHECK OUTPUT
nodi = Watch(firstItem)
campata = Watch(mm_m)
# note: INFORMAZIONI ELABORATE
altezza_interpiano = Watch(mm_m_2)
numero_di_campate = Watch(nodi_campate)
numero_di_piani = Watch(n1)
numero_di_telai = Watch(count)
b_e_h_sezioni_0_è_colone = Watch(addItemToFront)

round_2 = Math.Round(number=numero_di_campate)
g_nodi_kpa = CodeBlock { 4750000; }

# group: CREAZIONE DEL JSON OBJECT
indici = CodeBlock()
# ---------- indici.designscript (9 lines) ----------
[ "span" ,
"storey" ,
"n" ,
"m",
"r",
"mass",
"Heff",
"sections",
"G_Joints"];
# ----------------------------------------
# note: I METODI DI DYNAMO FANNO PENA
sections_dictionary = Python(IN[0]=MATERIALE, IN[1]=S, IN[2]=STRAIN, IN[3]=STRESS, IN[4]=numero_di_piani, IN[5]=b_e_h_sezioni_0_è_colone)
# ---------- sections_dictionary.python (28 lines) ----------
# Load the Python Standard and DesignScript Libraries
import sys
import clr
clr.AddReference('ProtoGeometry')
from Autodesk.DesignScript.Geometry import *

# The inputs to this node will be stored as a list in the IN variables.
materiale = IN[0]	# 0 Colonna, 1 Travi 
S_Links = IN[1]
PT_Strain = IN[2]
PT_Stress = IN[3]
m = IN[4]
sezioni = IN[5]

# Place your code below this line
dizionari = []
for j in range(m + 1):

	if j == 0:
		i = 0
	else:
		i = 1
		
	dizionario = {"Section" : sezioni[j], "Material" : materiale[i], "S" : S_Links[j], "Strain" : PT_Strain[j], "Stress" : PT_Stress[j]}
	dizionari.append(dizionario)
	
# Assign your output to the OUT variable.
OUT = dizionari
# ----------------------------------------
list_join_ma_fatto_bene_5 = Python(IN[0]=campata, IN[1]=altezza_interpiano, IN[2]=round_2, IN[3]=numero_di_piani, IN[4]=numero_di_telai, IN[5]=masse, IN[6]=heff_2, IN[7]=sections_dictionary, IN[8]=g_nodi_kpa)  # same code as list_join_ma_fatto_bene
byKeysValues = DesignScript.Builtin.Dictionary.ByKeysValues(keys=indici, values=list_join_ma_fatto_bene_5)
dizionario_di_output = Watch(byKeysValues)
byDictionary = JsonData.Elements.JsonObject.ByDictionary(dictionary=dizionario_di_output)
JSON = Watch(byDictionary)

# group: SCRITTURA OUTPUT
file_path = Filename("Output\Telaio.json")
toJsonFile = JsonData.Utilities.Write.ToJsonFile(jsonObjects=JSON, filepath=file_path)

# group: PUSHOVER
indici_2 = CodeBlock()
# ---------- indici_2.designscript (2 lines) ----------
[ "points",
"step"];
# ----------------------------------------
punti_pushover = CodeBlock { [0.1, -0.1, 0.15, -0.15, 0.2, -0.2, 0.25, -0.25, 0.25]; }
STEP = CodeBlock { 0.001; }
list_join_ma_fatto_bene_6 = Python(IN[0]=punti_pushover, IN[1]=STEP)  # same code as list_join_ma_fatto_bene
byKeysValues_2 = DesignScript.Builtin.Dictionary.ByKeysValues(keys=indici_2, values=list_join_ma_fatto_bene_6)
byDictionary_2 = JsonData.Elements.JsonObject.ByDictionary(dictionary=byKeysValues_2)
JSON_2 = Watch(byDictionary_2)

# group: SCRITTURA OUTPUT
file_path_2 = Filename("Output\Pushover.json")
toJsonFile_2 = JsonData.Utilities.Write.ToJsonFile(jsonObjects=JSON_2, filepath=file_path_2)

# group: TIMEHISTORY
code_block_9 = CodeBlock { "TimeHistory"; }
code_block_10 = CodeBlock()
# ---------- code_block_10.designscript (5 lines) ----------
["id",
"dt",
"sf",
"duration",
"TimeStepRatio"];
# ----------------------------------------
timeStepRatio = CodeBlock { 0.5; }
KALAMATA = CodeBlock(x=timeStepRatio) { 1; 0.005; 0.01; 35.875; x; }
list_create = List.Create(item0=KALAMATA.out0, item1=KALAMATA.out1, item2=KALAMATA.out2, item3=KALAMATA.out3, item4=KALAMATA.x)
byKeysValues_3 = DesignScript.Builtin.Dictionary.ByKeysValues(keys=code_block_10, values=list_create)
AMATRICE = CodeBlock(x=timeStepRatio) { 2; 0.005; 0.01; 27.895; x; }
list_create_2 = List.Create(item0=AMATRICE.out0, item1=AMATRICE.out1, item2=AMATRICE.out2, item3=AMATRICE.out3, item4=AMATRICE.x)
byKeysValues_4 = DesignScript.Builtin.Dictionary.ByKeysValues(keys=code_block_10, values=list_create_2)
aquila_k = CodeBlock(x=timeStepRatio) { 3; 0.005; 0.01; 100.000; x; }
list_create_3 = List.Create(item0=aquila_k.out0, item1=aquila_k.out1, item2=aquila_k.out2, item3=aquila_k.out3, item4=aquila_k.x)
byKeysValues_5 = DesignScript.Builtin.Dictionary.ByKeysValues(keys=code_block_10, values=list_create_3)
aquila_v = CodeBlock(x=timeStepRatio) { 4; 0.005; 0.01; 100.005; x; }
list_create_4 = List.Create(item0=aquila_v.out0, item1=aquila_v.out1, item2=aquila_v.out2, item3=aquila_v.out3, item4=aquila_v.x)
byKeysValues_6 = DesignScript.Builtin.Dictionary.ByKeysValues(keys=code_block_10, values=list_create_4)
NORCIA = CodeBlock(x=timeStepRatio) { 5; 0.005; 0.01; 60.000; x; }
list_create_5 = List.Create(item0=NORCIA.out0, item1=NORCIA.out1, item2=NORCIA.out2, item3=NORCIA.out3, item4=NORCIA.x)
byKeysValues_7 = DesignScript.Builtin.Dictionary.ByKeysValues(keys=code_block_10, values=list_create_5)
emilia_m = CodeBlock(x=timeStepRatio) { 6; 0.005; 0.01; 62.005; x; }
list_create_6 = List.Create(item0=emilia_m.out0, item1=emilia_m.out1, item2=emilia_m.out2, item3=emilia_m.out3, item4=emilia_m.x)
byKeysValues_8 = DesignScript.Builtin.Dictionary.ByKeysValues(keys=code_block_10, values=list_create_6)
emilia_q = CodeBlock(x=timeStepRatio) { 7; 0.005; 0.01; 170.005; x; }
list_create_7 = List.Create(item0=emilia_q.out0, item1=emilia_q.out1, item2=emilia_q.out2, item3=emilia_q.out3, item4=emilia_q.x)
byKeysValues_9 = DesignScript.Builtin.Dictionary.ByKeysValues(keys=code_block_10, values=list_create_7)
list_join_ma_fatto_bene_7 = Python(IN[0]=byKeysValues_3, IN[1]=byKeysValues_4, IN[2]=byKeysValues_5, IN[3]=byKeysValues_6, IN[4]=byKeysValues_7, IN[5]=byKeysValues_8, IN[6]=byKeysValues_9)  # same code as list_join_ma_fatto_bene

list_join_ma_fatto_bene_8 = Python(IN[0]=list_join_ma_fatto_bene_7)  # same code as list_join_ma_fatto_bene

# group (continued): TIMEHISTORY
byKeysValues_10 = DesignScript.Builtin.Dictionary.ByKeysValues(keys=code_block_9, values=list_join_ma_fatto_bene_8)
byDictionary_3 = JsonData.Elements.JsonObject.ByDictionary(dictionary=byKeysValues_10)
JSON_3 = Watch(byDictionary_3)

# group: SCRITTURA OUTPUT
file_path_3 = Filename("Output\TimeHistory.json")
toJsonFile_3 = JsonData.Utilities.Write.ToJsonFile(jsonObjects=JSON_3, filepath=file_path_3)
